# Grasshopper definition Playground Generator.gh (Grasshopper 0.8.61)

numtriangles = Slider(15, range=0..40)
crv = Curve(<curve referenced from the Rhino model>)

# ---- group: Triangle
geo = Geometry(<20, culture=neutral, publickeytoken=null referenced from the Rhino model>)

# ---- group: Triangle Plane
box = BoxComponents(Box=geo)  # -> Plane, X, Y, Z

# ---- group: Triangle Orientation
pframes = PerpFrames(Curve=crv, Number=numtriangles, Align=True)  # -> Frames, Parameters
pcomp = PlaneComponents(Plane=pframes.Frames)  # -> Origin, XAxis, YAxis, ZAxis
pl = Plane(Origin=pcomp.Origin, XAxis=pcomp.ZAxis, YAxis=pcomp.XAxis)
orient = Orient(Geometry=geo, Initial=box.Plane, Final=pl)  # -> Geometry, Transform

# ----
intslider = Slider(0, range=0..2)
cull = CullPattern(List=pl, CullPattern=[True, False])
cull_2 = CullPattern(List=orient.Geometry, CullPattern=[True, False])
explode = BrepComponents(Brep=cull_2)  # -> Faces, Edges, Vertices
area = Area(Geometry=cull_2)  # -> Area, Centroid
pcomp_2 = PlaneComponents(Plane=cull)  # -> Origin, XAxis, YAxis, ZAxis
graft = GraftTree(Data=area.Centroid, Strip=False)
item = ListItem(List=explode.Edges, Index=intslider, Wrap=False)
item_2 = ListItem(List=explode.Vertices, Index=intslider, Wrap=False)

# ---- group: ptDown Triangle
cull_3 = CullPattern(List=orient.Geometry, CullPattern=[False, True])

# ----
simplify = SimplifyTree(Tree=graft, Front=False)
curvepoint = PointOnCurve(item, parameter=0.5)
simplify_2 = SimplifyTree(Tree=item_2, Front=False)
simplify_3 = SimplifyTree(Tree=curvepoint, Front=False)
vec2pt = Vector2Pt(PointA=simplify, PointB=simplify_2, Unitize=False)  # -> Vector, Length
vec2pt_2 = Vector2Pt(PointA=simplify, PointB=simplify_3, Unitize=False)  # -> Vector, Length
subtraction = Subtraction(A=vec2pt.Length, B=vec2pt_2.Length)
multiplication = Multiplication(A=subtraction, B=-1)
rot3d = Rotate3D(Geometry=cull_2, Angle=3.141592654, Center=area.Centroid, Axis=pcomp_2.XAxis)  # -> Geometry, Transform
Z = UnitZ(Factor=multiplication)

# ---- group: ptUp Triangle
move = Move(Geometry=rot3d.Geometry, Translation=Z)  # -> Geometry, Transform

# ----
pcen = PolygonCenter(Polyline=cull_3)  # -> CenterV, CenterE

# ---- group: Generate Random Rotation Angle
lng = ListLength(List=cull_3)
random = Random(Range=Domain(-0.4, 0.4), Number=lng, Seed=2, Integers=False)
rot3d_2 = Rotate3D(Geometry=cull_3, Angle=random, Center=pcen.CenterV, Axis=pcomp_2.XAxis)  # -> Geometry, Transform

# ----
merge = Merge(Data1=rot3d_2.Geometry, Data2=move.Geometry)
lng_2 = ListLength(List=merge)
division = Division(A=lng_2, B=4)
series = Series(Start=1, Step=1, Count=division)
rev = ReverseList(List=series)
merge_2 = Merge(Data1=rev, Data2=series)
merge_3 = Merge(Data1=rev, Data2=series)
series_2 = Series(Start=0, Step=1, Count=10)
flatten = FlattenTree(Data=merge_3, Path="{0}")
flatten_2 = FlattenTree(Data=merge_2, Path="{0}")
merge_4 = Merge(Data1=flatten, Data2=flatten_2)
bnd = Bounds(Numbers=merge_4)
intslider_2 = Slider(1, range=0.75..1.5)
remap = RemapNumbers(Values=merge_4, Source=bnd, Target=Domain(1.4, 1))
panel = Panel(merge_4)
multiplication_2 = Multiplication(A=remap, B=intslider_2)
cull_4 = CullPattern(List=multiplication_2, CullPattern=[False, True])
scale = Scale(Geometry=rot3d_2.Geometry, Center=pcen.CenterV, Factor=cull_4)  # -> Geometry, Transform
cull_5 = CullPattern(List=multiplication_2, CullPattern=[True, False])
panel_2 = Panel(cull_4)
panel_3 = Panel(cull_5)
pcen_2 = PolygonCenter(Polyline=move.Geometry)  # -> CenterV, CenterE
scale_2 = Scale(Geometry=move.Geometry, Center=pcen_2.CenterV, Factor=cull_5)  # -> Geometry, Transform
explode_2 = BrepComponents(Brep=scale_2.Geometry)  # -> Faces, Edges, Vertices
simplify_4 = SimplifyTree(Tree=explode_2.Vertices, Front=False)

# ---- group: ptDown Components
explode_3 = BrepComponents(Brep=scale.Geometry)  # -> Faces, Edges, Vertices

# ----
simplify_5 = SimplifyTree(Tree=explode_3.Vertices, Front=False)
simplify_6 = SimplifyTree(Tree=explode_3.Edges, Front=False)

# ---- group: ptUp vertices
intslider_3 = Slider(1, range=0..2)
intslider_4 = Slider(2, range=0..2)
item_3 = ListItem(List=simplify_4, Index=0, Wrap=False)
item_4 = ListItem(List=simplify_4, Index=intslider_3, Wrap=False)
item_5 = ListItem(List=simplify_4, Index=intslider_4, Wrap=False)

# ---- group: List of ptUp Triangle Edges
intslider_5 = Slider(2, range=0..2)
intslider_6 = Slider(1, range=0..2)
simplify_7 = SimplifyTree(Tree=explode_2.Edges, Front=False)
item_6 = ListItem(List=simplify_7, Index=intslider_5, Wrap=False)
item_7 = ListItem(List=simplify_7, Index=intslider_6, Wrap=False)
item_8 = ListItem(List=simplify_7, Index=0, Wrap=False)

# ---- group: ptDown Edges
edge2 = Slider(2, range=0..2)
edge1 = Slider(1, range=0..2)
edge0 = Slider(0, range=0..2)
item_9 = ListItem(List=simplify_6, Index=edge2, Wrap=False)
item_10 = ListItem(List=simplify_6, Index=edge1, Wrap=False)
item_11 = ListItem(List=simplify_6, Index=edge0, Wrap=False)

# ---- group: ptDown Vertices
vertex2 = Slider(2, range=0..2)
vertex2_2 = Slider(1, range=0..2)
item_12 = ListItem(List=simplify_5, Index=0, Wrap=False)
item_13 = ListItem(List=simplify_5, Index=vertex2_2, Wrap=False)
item_14 = ListItem(List=simplify_5, Index=vertex2, Wrap=False)

# ----
flatten_3 = FlattenTree(Data=item_7, Path="{0}")
flatten_4 = FlattenTree(Data=item_3, Path="{0}")
flatten_5 = FlattenTree(Data=item_4, Path="{0}")
flatten_6 = FlattenTree(Data=item_5, Path="{0}")
item_15 = ListItem(List=flatten_3, Index=0, Wrap=False)
cull_i = CullIndex(List=flatten_4, Indices=0, Wrap=False, DataComparison="shortest_list")
cull_i_2 = CullIndex(List=flatten_5, Indices=0, Wrap=False, DataComparison="shortest_list")
cull_i_3 = CullIndex(List=flatten_6, Indices=0, Wrap=False, DataComparison="shortest_list")
graft_2 = GraftTree(Data=cull_i, Strip=False)
graft_3 = GraftTree(Data=cull_i_2, Strip=False)
graft_4 = GraftTree(Data=cull_i_3, Strip=False)
simplify_8 = SimplifyTree(Tree=graft_2, Front=False)
simplify_9 = SimplifyTree(Tree=graft_3, Front=False)
simplify_10 = SimplifyTree(Tree=graft_4, Front=False)

# ---- group: Merge Vertices into List
merge_5 = Merge(Data1=item_4, Data2=item_12, Data3=item_5)

# ----
merge_6 = Merge(Data1=item_14, Data2=item_3, Data3=item_13, Data4=simplify_8, Data5=item_14)
merge_7 = Merge(Data1=simplify_9, Data2=item_12, Data3=simplify_10)

# ---- group: Draw Polylines
pline = PolyLine(Vertices=merge_5, Closed=False)

# ----
pline_2 = PolyLine(Vertices=merge_6, Closed=True)
pline_3 = PolyLine(Vertices=merge_7, Closed=False)

# ---- group: Explode Polylines
explode_4 = Explode(Curve=pline, Recursive=True)  # -> Segments, Vertices

# ----
simplify_11 = SimplifyTree(Tree=explode_4.Segments, Front=False)
explode_5 = Explode(Curve=pline_2, Recursive=True)  # -> Segments, Vertices
explode_6 = Explode(Curve=pline_3, Recursive=True)  # -> Segments, Vertices
simplify_12 = SimplifyTree(Tree=explode_5.Segments, Front=False)

# ---- group: Isolate into Lists
item_16 = ListItem(List=simplify_11, Index=0, Wrap=False)
item_17 = ListItem(List=simplify_11, Index=1, Wrap=False)

# ----
item_18 = ListItem(List=explode_6.Segments, Index=0, Wrap=False)
item_19 = ListItem(List=explode_6.Segments, Index=1, Wrap=False)

# ---- group: Top
item_20 = ListItem(List=simplify_12, Index=1, Wrap=False)
item_21 = ListItem(List=simplify_12, Index=2, Wrap=False)
item_22 = ListItem(List=simplify_12, Index=3, Wrap=False)
item_23 = ListItem(List=simplify_12, Index=0, Wrap=False)

# ----
flatten_7 = FlattenTree(Data=item_19, Path="{0}")
flatten_8 = FlattenTree(Data=item_18, Path="{0}")
graft_5 = GraftTree(Data=flatten_7, Strip=False)
graft_6 = GraftTree(Data=flatten_8, Strip=False)
simplify_13 = SimplifyTree(Tree=graft_5, Front=False)
simplify_14 = SimplifyTree(Tree=graft_6, Front=False)
clean = CleanTree(Data=simplify_13, CleanInvalid=True, CleanEmpty=False)
panel_4 = Panel(clean)
random_2 = Random(Range=Domain(0, 1), Number=1, Seed=2, Integers=False)

# ---- group: Merge All Edges
merge_8 = Merge(
    Data1=item_9,
    Data2=item_10,
    Data3=item_11,
    Data4=item_6,
    Data5=item_7,
    Data6=item_8,
    Data7=item_16,
    Data8=item_17,
    Data9=simplify_14,
    Data10=simplify_13,
    Data11=item_23,
    Data12=item_20,
    Data13=item_21,
    Data14=item_22)

# ----
jointlength = Slider(0.16, range=0..2)

# ---- group: Merge Edges Surrounding Joint
merge_9 = Merge(Data1=item_9, Data2=item_10, Data3=item_20, Data4=item_21)

# ---- group: ptUp Joints
merge_10 = Merge(Data1=item_6, Data2=item_8, Data3=item_17)
merge_11 = Merge(Data1=clean)
merge_12 = Merge(Data1=item_6, Data2=item_7, Data3=item_16)
merge_13 = Merge(Data1=simplify_14)
merge_14 = Merge(Data1=item_8, Data2=item_7, Data3=item_23, Data4=item_20)
merge_15 = Merge(Data1=item_22, Data2=item_21)
curvepoint_2 = PointOnCurve(merge_10, parameter=0.5)
curvepoint_3 = PointOnCurve(merge_11, parameter=0.5)
curvepoint_4 = PointOnCurve(merge_12, parameter=0.5)
curvepoint_5 = PointOnCurve(merge_13, parameter=0.5)
curvepoint_6 = PointOnCurve(merge_14, parameter=0.5)
curvepoint_7 = PointOnCurve(merge_15, parameter=0.5)
vec2pt_3 = Vector2Pt(PointA=item_5, PointB=curvepoint_2, Unitize=True)  # -> Vector, Length
vec2pt_4 = Vector2Pt(PointA=simplify_10, PointB=curvepoint_3, Unitize=True)  # -> Vector, Length
vec2pt_5 = Vector2Pt(PointA=item_4, PointB=curvepoint_4, Unitize=True)  # -> Vector, Length
vec2pt_6 = Vector2Pt(PointA=simplify_9, PointB=curvepoint_5, Unitize=True)  # -> Vector, Length
vec2pt_7 = Vector2Pt(PointA=item_3, PointB=curvepoint_6, Unitize=True)  # -> Vector, Length
vec2pt_8 = Vector2Pt(PointA=simplify_8, PointB=curvepoint_7, Unitize=True)  # -> Vector, Length
line = LineSDL(Start=item_5, Direction=vec2pt_3.Vector, Length=jointlength)
line_2 = LineSDL(Start=simplify_10, Direction=vec2pt_4.Vector, Length=jointlength, DataComparison="shortest_list")
line_3 = LineSDL(Start=item_4, Direction=vec2pt_5.Vector, Length=jointlength)
line_4 = LineSDL(Start=simplify_9, Direction=vec2pt_6.Vector, Length=jointlength)
line_5 = LineSDL(Start=item_3, Direction=vec2pt_7.Vector, Length=jointlength)
line_6 = LineSDL(Start=simplify_8, Direction=vec2pt_8.Vector, Length=jointlength)

# ---- group: PtDown Joints
merge_16 = Merge(Data1=item_9, Data2=item_10, Data3=item_20, Data4=item_21)
merge_17 = Merge(Data1=item_23, Data2=item_22, Data3=item_9, Data4=item_11)
merge_18 = Merge(Data1=item_16, Data2=item_17, Data3=simplify_14, Data4=simplify_13, Data5=item_10, Data6=item_11)
curvepoint_8 = PointOnCurve(merge_16, parameter=0.5)
curvepoint_9 = PointOnCurve(merge_17, parameter=0.5)
curvepoint_10 = PointOnCurve(merge_18, parameter=0.5)
vec2pt_9 = Vector2Pt(PointA=item_13, PointB=curvepoint_8, Unitize=True)  # -> Vector, Length
vec2pt_10 = Vector2Pt(PointA=item_14, PointB=curvepoint_9, Unitize=True)  # -> Vector, Length
vec2pt_11 = Vector2Pt(PointA=item_12, PointB=curvepoint_10, Unitize=True)  # -> Vector, Length
line_7 = LineSDL(Start=item_13, Direction=vec2pt_9.Vector, Length=jointlength)
line_8 = LineSDL(Start=item_14, Direction=vec2pt_10.Vector, Length=jointlength)
line_9 = LineSDL(Start=item_12, Direction=vec2pt_11.Vector, Length=jointlength)

# ----
scalefactor = Slider(0.945, range=0..1)
curvepoint_11 = PointOnCurve(merge_8, parameter=0.5)
curvepoint_12 = PointOnCurve(merge_9, parameter=0.5)
scale_3 = Scale(Geometry=merge_8, Center=curvepoint_11, Factor=scalefactor)  # -> Geometry, Transform

# ---- group: Create Vector btn Endpoint & Midpoint
vec2pt_12 = Vector2Pt(PointA=item_13, PointB=curvepoint_12, Unitize=True)  # -> Vector, Length

# ----
bamboo_length = Slider(0.033, range=0..1)
jointradius = Slider(0.045, range=0..0.1)

# ---- group: Draw New Line
line_10 = LineSDL(Start=item_13, Direction=vec2pt_12.Vector, Length=jointlength)

# ---- group: Bamboo Members
pipe = Pipe(Curve=scale_3.Geometry, Radius=bamboo_length, Caps=0)

# ----
len = Length(Curve=line_6)
panel_5 = Panel(len)

# ---- group: Create Geometry
pipe_2 = Pipe(Curve=line_10, Radius=jointradius, Caps=1)

# ----
merge_19 = Merge(
    Data1=merge_16,
    Data2=merge_17,
    Data3=merge_18,
    Data4=merge_10,
    Data5=merge_11,
    Data6=merge_12,
    Data7=merge_13,
    Data8=merge_14,
    Data9=merge_15)

# ---- group: All Edges
merge_20 = Merge(Data1=simplify_5, Data2=simplify_4)

# ---- group: All Joints
merge_21 = Merge(
    Data1=line_7,
    Data2=line_8,
    Data3=line_9,
    Data4=line,
    Data5=line_2,
    Data6=line_3,
    Data7=line_4,
    Data8=line_5,
    Data9=line_6)

# ----
width = Slider(0.045, range=0..0.1)
intslider_7 = Slider(0.945, range=0..1)

# ---- group: Dowel Lengths
len_2 = Length(Curve=simplify_7)
multiplication_3 = Multiplication(A=len_2, B=intslider_7)
len_3 = Length(Curve=simplify_6)
multiplication_4 = Multiplication(A=len_3, B=intslider_7)
len_4 = Length(Curve=item_23)
multiplication_5 = Multiplication(A=len_4, B=intslider_7)
len_5 = Length(Curve=item_20)
multiplication_6 = Multiplication(A=len_5, B=intslider_7)
len_6 = Length(Curve=item_22)
multiplication_7 = Multiplication(A=len_6, B=intslider_7)
len_7 = Length(Curve=item_21)
multiplication_8 = Multiplication(A=len_7, B=intslider_7)
len_8 = Length(Curve=item_16)
multiplication_9 = Multiplication(A=len_8, B=intslider_7)
len_9 = Length(Curve=item_17)
multiplication_10 = Multiplication(A=len_9, B=intslider_7)
len_10 = Length(Curve=item_18)
multiplication_11 = Multiplication(A=len_10, B=intslider_7)
len_11 = Length(Curve=item_19)
multiplication_12 = Multiplication(A=len_11, B=intslider_7)

# ---- group: Dowel Lengths / PtUp Triangle
panel_6 = Panel(multiplication_3)

# ---- group: Dowel Lengths / PtDown Triangle
panel_7 = Panel(multiplication_4)

# ----
panel_8 = Panel(line_10)
curvepoint_13 = PointOnCurve(merge_19, parameter=0.5)

# ---- group: Dowel Lengths / Connection: Top 1
panel_9 = Panel(multiplication_5)

# ----
scale_4 = Scale(Geometry=merge_19, Center=curvepoint_13, Factor=intslider_7)  # -> Geometry, Transform

# ---- group: Joint Geometry
pipe_3 = Pipe(Curve=merge_21, Radius=width, Caps=1)
sph = Sphere(Base=merge_20, Radius=width)

# ----
panel_10 = Panel(merge_19)
pipe_4 = Pipe(Curve=scale_4.Geometry, Radius=bamboo_length, Caps=1)

# ---- group: Dowel Lengths / Connection: Top 2
panel_11 = Panel(multiplication_6)

# ----
sdiff = SolidDifference(SecondSet=pipe_4)

# ---- group: Dowel Lengths / Connection: Top 3
panel_12 = Panel(multiplication_7)

# ---- group: Dowel Lengths / Connection: Top 4
panel_13 = Panel(multiplication_8)

# ---- group: Dowel Lengths / Connection: Bottom 1
panel_14 = Panel(multiplication_9)

# ---- group: Dowel Lengths / Connection: Bottom 2
panel_15 = Panel(multiplication_10)

# ---- group: Dowel Lengths / Connection: Bottom 3
panel_16 = Panel(multiplication_11)

# ---- group: Dowel Lengths / Connection: Bottom 4
panel_17 = Panel(multiplication_12)

# ---- group: Fabric
geo_2 = Geometry([<20, culture=neutral, publickeytoken=null referenced from the Rhino model> x14])
geo_3 = Geometry([<20, culture=neutral, publickeytoken=null referenced from the Rhino model> x14])
geo_4 = Geometry([<20, culture=neutral, publickeytoken=null referenced from the Rhino model> x14])
volume = Volume(Geo=geo_2)  # -> Volume, Centroid
volume_2 = Volume(Geo=geo_3)  # -> Volume, Centroid
volume_3 = Volume(Geo=geo_4)  # -> Volume, Centroid
graft_7 = GraftTree(Data=volume_2.Centroid, Strip=False)
graft_8 = GraftTree(Data=volume_3.Centroid, Strip=False)
graft_9 = GraftTree(Data=volume.Centroid, Strip=False)
merge_22 = Merge(Data1=graft_9, Data2=graft_7, Data3=graft_8)
simplify_15 = SimplifyTree(Tree=merge_22, Front=False)
item_24 = ListItem(List=merge_22, Index=2, Wrap=False)
item_25 = ListItem(List=merge_22, Index=1, Wrap=False)
item_26 = ListItem(List=merge_22, Index=0, Wrap=False)
pline_4 = PolyLine(Vertices=simplify_15, Closed=True)
area_2 = Area(Geometry=pline_4)  # -> Area, Centroid
flatten_9 = FlattenTree(Data=area_2.Centroid, Path="{0}")
cull_6 = CullPattern(List=flatten_9, CullPattern=[False, True])
cull_7 = CullPattern(List=flatten_9, CullPattern=[True, False])
simplify_16 = SimplifyTree(Tree=item_24, Front=False)
simplify_17 = SimplifyTree(Tree=item_25, Front=False)
simplify_18 = SimplifyTree(Tree=item_26, Front=False)
flatten_10 = FlattenTree(Data=item_26, Path="{0}")
flatten_11 = FlattenTree(Data=item_25, Path="{0}")
flatten_12 = FlattenTree(Data=item_24, Path="{0}")
cull_8 = CullPattern(List=flatten_10, CullPattern=[True, False])
cull_9 = CullPattern(List=flatten_10, CullPattern=[False, True])
cull_10 = CullPattern(List=flatten_11, CullPattern=[True, False])
cull_11 = CullPattern(List=flatten_11, CullPattern=[False, True])
cull_12 = CullPattern(List=flatten_12, CullPattern=[True, False])
cull_13 = CullPattern(List=flatten_12, CullPattern=[False, True])
flatten_13 = FlattenTree(Data=cull_7, Path="{0}")
cull_i_4 = CullIndex(List=flatten_13, Indices=0, Wrap=False, DataComparison="shortest_list")
merge_23 = Merge(Data1=simplify_18, Data2=area_2.Centroid, Data3=simplify_17)
merge_24 = Merge(Data1=simplify_17, Data2=area_2.Centroid, Data3=simplify_16)
merge_25 = Merge(Data1=simplify_18, Data2=area_2.Centroid, Data3=simplify_16)
vec2pt_13 = Vector2Pt(PointA=cull_7, PointB=cull_i_4, Unitize=False)  # -> Vector, Length
ln = Line(PointA=cull_6, PointB=cull_i_4)
incircle = InCircle(CornerA=cull_9, CornerB=cull_11, CornerC=cull_13)  # -> Circle, Plane, Radius
curvepoint_14 = PointOnCurve(ln, parameter=0.5)
flatten_14 = FlattenTree(Data=incircle.Radius, Path="{0}")
division_2 = Division(A=flatten_14, B=1.15)
amp = Amplitude(Vector=vec2pt_13.Vector, Amplitude=division_2)
circle = CircleCNR(Center=curvepoint_14, Normal=amp, Radius=division_2)
crv_2 = Curve(Vertices=merge_23, Degree=2, Periodic=False)  # -> Curve, Length, Domain
crv_3 = Curve(Vertices=merge_24, Degree=2, Periodic=False)  # -> Curve, Length, Domain
crv_4 = Curve(Vertices=merge_25, Degree=2, Periodic=False)  # -> Curve, Length, Domain
merge_26 = Merge(Data1=crv_2.Curve, Data2=crv_3.Curve, Data3=crv_4.Curve)
cull_14 = CullPattern(List=circle, CullPattern=[True, False])
cen = Center(Arc=cull_14)  # -> Center, Radius
cull_15 = CullPattern(List=circle, CullPattern=[False, True])
scale_5 = Scale(Geometry=cull_14, Center=cen.Center, Factor=0.8)  # -> Geometry, Transform

# ---- group: Fabric / Line Connecting Midpoints
ln_2 = Line(PointA=cull_7, PointB=cull_6)

# ---- group: Fabric / Acquire Line Direction
vec2pt_14 = Vector2Pt(PointA=cull_7, PointB=cull_6, Unitize=False)  # -> Vector, Length

# ---- group: Fabric / Draw Circle From Triangle
incircle_2 = InCircle(CornerA=cull_8, CornerB=cull_10, CornerC=cull_12)  # -> Circle, Plane, Radius

# ---- group: Fabric / Vertex Extracted
item_27 = ListItem(List=merge_22, Index=0, Wrap=False)

# ---- group: Fabric / Join all Curves
join = JoinCurves(Curves=merge_26, Preserve=False)

# ---- group: Fabric (continued)
flatten_15 = FlattenTree(Data=incircle_2.Radius, Path="{0}")
curvepoint_15 = PointOnCurve(ln_2, parameter=0.5)
simplify_19 = SimplifyTree(Tree=item_27, Front=False)
flatten_16 = FlattenTree(Data=item_27, Path="{0}")
simplify_20 = SimplifyTree(Tree=join, Front=False)
flatten_17 = FlattenTree(Data=simplify_20, Path="{0}")

# ---- group: Fabric / Reduce Radius
division_3 = Division(A=flatten_15, B=1.15)

# ---- group: Fabric / Separate Consecutive Vertices
cull_16 = CullPattern(List=flatten_16, CullPattern=[True, False])
cull_17 = CullPattern(List=flatten_16, CullPattern=[False, True])

# ---- group: Fabric / Merge Two Vertices & Midpoint of Triangle
merge_27 = Merge(Data1=simplify_19, Data2=area_2.Centroid, Data3=simplify_17)

# ---- group: Fabric / Draw Curve
crv_5 = Curve(Vertices=merge_27, Degree=2, Periodic=False)  # -> Curve, Length, Domain

# ---- group: Fabric / Merge Geometries
loft = Loft(Section=flatten_17, Options={Adjust=False, Closed=False, Rebuild=10, Refit=0.01, LoftType=0, LoftEnds=0, LoftSimp=0})

# ---- group: Fabric (continued)
amp_2 = Amplitude(Vector=vec2pt_14.Vector, Amplitude=division_3)

# ---- group: Fabric / Circle btn triangles
circle_2 = CircleCNR(Center=curvepoint_15, Normal=amp_2, Radius=division_3)

# ---- group: Fabric (continued)
cull_18 = CullPattern(List=circle_2, CullPattern=[False, True])
cen_2 = Center(Arc=cull_18)  # -> Center, Radius
cull_19 = CullPattern(List=circle_2, CullPattern=[True, False])
scale_6 = Scale(Geometry=cull_18, Center=cen_2.Center, Factor=0.8)  # -> Geometry, Transform
